# Grasshopper definition CSMathGH.gh (Grasshopper 0.9.76)
# plug-ins: CSMathGH

degree = Slider(804, range=-90..1000)

number_slider = Slider(1, range=0..1)  # disabled
Y = UnitY(Factor=1)  # disabled
xy = XYPlane(Origin=Point(0, 0, 0))  # disabled
pt = ConstructPoint(XCoordinate=0, YCoordinate=0, ZCoordinate=number_slider)  # disabled
Z = UnitZ(Factor=1)  # disabled
pt_2 = ParallelTransport(Plane=xy, Point=pt, Vector=Z)  # disabled

xy_2 = XYPlane(Origin=Point(0, 0, 0))
rad = Radians(Degrees=degree)
zrotate = ZRotateAPlane(Plane=xy_2, Angle=rad)
rotate = Rotate(Geometry=xy_2, Angle=rad, Plane=xy_2)  # -> Geometry, Transform
deplane = DeconstructPlane(Plane=zrotate)  # -> Origin, XAxis, YAxis, ZAxis
deplane_2 = DeconstructPlane(Plane=rotate.Geometry)  # -> Origin, XAxis, YAxis, ZAxis
angle = Angle(VectorA=deplane.XAxis, VectorB=deplane_2.XAxis, Plane=xy_2)  # -> Angle, Reflex
min = Minimum(A=angle.Angle, B=angle.Reflex)
deg = Degrees(Radians=min)
panel = Panel(deg)
